# Grasshopper definition Week1_all.gh (Grasshopper 1.0.8)

# ---- group: RhinoCommon
point_vector = Python3Script()  # -> out, base_pt, moved_pt
# ---------- point_vector: Python ----------
import Rhino.Geometry as geo

# 기본 점 생성
base_pt = geo.Point3d(0, 0, 0)

# 점의 X 좌표 출력
print(base_pt.X)

# 점간의 거리 계산
test_pt = geo.Point3d(3, 4, 0)
print(base_pt.DistanceTo(test_pt))

# 점의 좌표 유사성 판단
print(base_pt.EpsilonEquals(test_pt, 0.01))

# 벡터 생성
vec = geo.Vector3d(10, 5, 3)

# 벡터의 길이 출력
print("Length of the vector:", vec.Length)

# 벡터를 사용하여 점 이동
moved_pt = base_pt + vec
# ---------- end point_vector ----------
curve = Python3Script()  # -> out, pts, base_crv, closed_crv, nurbs_crv
# ---------- curve: Python ----------
import Rhino.Geometry as geo

# 1. 기본적은 폴리라인 커브 생성
pts = [geo.Point3d(i, i * i * 0.1, 0) for i in range(-5, 6)]
base_crv = geo.PolylineCurve(pts)

# 커브의 길이 계산
length = base_crv.GetLength()
print("Length of the curve:", length)

# 2. 커브를 닫아서 루프 생성
# 커브를 닫기 위해 첫번째 점을 마지막에 추가
closed_crv = geo.PolylineCurve(pts + [pts[0]])

# 3. 커브의 닫힘 여부 확인
print("Is the curve closed?", closed_crv.IsClosed)

# 4. 커브의 면적 계산
area = geo.AreaMassProperties.Compute(closed_crv).Area
print("Area of the closed curve:", area)

# 5. 커브의 제어점 수 출력
print("Number of control points:", closed_crv.PointCount)

# 6. 커브의 모서리 수 출력
print("Number of span counts:", closed_crv.SpanCount)

# Nurbs 곡선 커브 생성
nurbs_crv = geo.NurbsCurve.CreateControlPointCurve(pts, 3)
# ---------- end curve ----------
brep = Python3Script()  # -> out, surface, extrusion, sphere, brep, brep_x
# ---------- brep: Python ----------
import Rhino.Geometry as geo


# 1. 닫힌 커브로부터 평면 서페이스 생성
pts = [
    geo.Point3d(1, 1, 1),
    geo.Point3d(2, 2, 2),
    geo.Point3d(3, 1, 1),
    geo.Point3d(2, 0, 0),
    geo.Point3d(1, 1, 1),
]
base_region = geo.PolylineCurve(pts)
print (base_region.IsClosed)

surface = geo.Brep.CreatePlanarBreps(base_region)[0]


# 2. 레일을 따라 선형 돌출 생성
rail_crv = geo.Line(geo.Point3d(0, 0, 0), geo.Point3d(10, 0, 0)).ToNurbsCurve()
extrusion = geo.Surface.CreateExtrusion(rail_crv, geo.Vector3d(0, 0, 5))

# 3. 구면을 생성하고 변환 적용
sphere = geo.Sphere(geo.Point3d(0, 0, 0), 5)
brep = geo.Brep.CreateFromSphere(sphere)
xform = geo.Transform.Translation(10, 0, 0)
brep_x = brep.Duplicate()
brep_x.Transform(xform)
# ---------- end brep ----------
geo = Geometry(brep.brep)
geo_2 = Geometry(point_vector.base_pt)
geo_3 = Geometry(point_vector.moved_pt)
geo_4 = Geometry(curve.pts)
geo_5 = Geometry(brep.sphere)
geo_6 = Geometry(brep.brep_x)
geo_7 = Geometry(curve.base_crv)

# ----
geo_8 = Geometry(brep.surface)
geo_9 = Geometry(brep.extrusion)
geo_10 = Geometry(curve.closed_crv)
geo_11 = Geometry(curve.nurbs_crv)
panel = Panel(point_vector.out)
py3 = Python3Script(x=Slider(3, range=0..10), y=Slider(4, range=0..10))  # -> out, a
# ---------- py3: Python ----------
print(x)
print(y)
print("X+Y = ", x+y)

a = x + y
# ---------- end py3 ----------
panel_2 = Panel(curve.out)
python_3_script = Python3Script()  # -> out, a
# ---------- python_3_script: Python ----------
import util_func

print (utils.__dict__)
print (utils.get_dist_between_crvs(x,y))
# ---------- end python_3_script ----------
panel_3 = Panel(py3.out)
panel_4 = Panel(py3.a)

# ---- group: RhinoCommon
point_vector_2 = Python3Script(script=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)  # -> out, base_pt, moved_pt; same code as point_vector
curve_2 = Python3Script(script=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)  # -> out, pts, base_crv, closed_crv, nurbs_crv; same code as curve
brep_2 = Python3Script(script=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)  # -> out, surface, extrusion, sphere, brep, brep_x; same code as brep
geo_12 = Geometry(brep_2.sphere)
geo_13 = Geometry(brep_2.brep)
geo_14 = Geometry(point_vector_2.base_pt)
geo_15 = Geometry(point_vector_2.moved_pt)
geo_16 = Geometry(curve_2.pts)
geo_17 = Geometry(brep_2.brep_x)
geo_18 = Geometry(curve_2.base_crv)

# ----
geo_19 = Geometry(brep_2.surface)
geo_20 = Geometry(brep_2.extrusion)
geo_21 = Geometry(curve_2.nurbs_crv)
geo_22 = Geometry(curve_2.closed_crv)
panel_5 = Panel(brep_2.out)
panel_6 = Panel(point_vector_2.out)
panel_7 = Panel(curve_2.out)

# ---- group: rhinoscriptsyntax
point_vector_3 = Python3Script()  # -> out, moved, base
# ---------- point_vector_3: Python ----------
import Rhino.Geometry as geo

base = geo.Point3d(0, 0, 0)
vec = geo.Vector3d(10, 5, 3)
moved = base + vec
import rhinoscriptsyntax as rs


base = rs.AddPoint(0, 0, 0)
vec = [10, 5, 3]
moved = rs.PointAdd(base, vec)
# ---------- end point_vector_3 ----------
curve_3 = Python3Script()  # -> out, pts, curve, rail, surface
# ---------- curve_3: Python ----------
import rhinoscriptsyntax as rs

pts = [rs.AddPoint(i, i * i * 0.1, 0) for i in range(-5, 6)]
curve = rs.AddInterpCurve(pts, degree=3)

rail_start = (0, 0, 0)
rail_end = (0, 0, 10)
rail = rs.AddLine(rail_start, rail_end)

surface = rs.ExtrudeCurveStraight(curve, (0, 0, 0), (0, 0, 5))
# ---------- end curve_3 ----------
brep_3 = Python3Script()  # -> out, sphere, brep, brep_x
# ---------- brep_3: Python ----------
import rhinoscriptsyntax as rs

center = (0, 0, 0)
radius = 5
sphere = rs.AddSphere(center, radius)
brep = sphere
brep_x = rs.CopyObject(sphere, translation=(10, 0, 0))
# ---------- end brep_3 ----------
geo_23 = Geometry(point_vector_3.base)
geo_24 = Geometry(curve_3.pts)
geo_25 = Geometry(curve_3.curve)
geo_26 = Geometry(curve_3.rail)
geo_27 = Geometry(curve_3.surface)
geo_28 = Geometry(brep_3.sphere)
geo_29 = Geometry(brep_3.brep)
geo_30 = Geometry(brep_3.brep_x)
geo_31 = Geometry(point_vector_3.moved)
