# Grasshopper definition Week1_all.ghx (Grasshopper 1.0.8)

# ---- group: RhinoCommon
point_vector = Python3Script()  # -> out, moved, base
# ---------- point_vector: Python ----------
import Rhino.Geometry as geo

base = geo.Point3d(0, 0, 0)
vec = geo.Vector3d(10, 5, 3)
moved = base + vec
# ---------- end point_vector ----------
curve = Python3Script()  # -> out, pts, curve, rail, surface
# ---------- curve: Python ----------
import Rhino.Geometry as geo

pts = [geo.Point3d(i, i*i*0.1, 0) for i in range(-5, 6)]
curve = geo.NurbsCurve.Create(False, 3, pts)

rail = geo.Line(geo.Point3d(0,0,0), geo.Point3d(0,0,10)).ToNurbsCurve()
surface = geo.Surface.CreateExtrusion(curve, geo.Vector3d(0,0,5))
# ---------- end curve ----------
brep = Python3Script()  # -> out, sphere, brep, brep_x
# ---------- brep: Python ----------
import Rhino.Geometry as geo

sphere = geo.Sphere(geo.Point3d(0,0,0), 5)
brep = geo.Brep.CreateFromSphere(sphere)
xform = geo.Transform.Translation(10, 0, 0)
brep_x = brep.Duplicate()
brep_x.Transform(xform)
# ---------- end brep ----------
geo = Geometry(point_vector.moved)
geo_2 = Geometry(point_vector.base)
geo_3 = Geometry(curve.pts)
geo_4 = Geometry(curve.curve)
geo_5 = Geometry(curve.rail)
geo_6 = Geometry(curve.surface)
geo_7 = Geometry(brep.sphere)
geo_8 = Geometry(brep.brep)
geo_9 = Geometry(brep.brep_x)

# ----
py3 = Python3Script(x=Slider(3, range=0..10), y=Slider(4, range=0..10))  # -> out, a
# ---------- py3: Python ----------
print(x)
print(y)
print("X+Y = ", x+y)

a = x + y
# ---------- end py3 ----------
panel = Panel(py3.out)
panel_2 = Panel(py3.a)

# ---- group: rhinoscriptsyntax
point_vector_2 = Python3Script()  # -> out, moved, base
# ---------- point_vector_2: Python ----------
import rhinoscriptsyntax as rs


base = rs.AddPoint(0, 0, 0)
vec = [10, 5, 3]
moved = rs.PointAdd(base, vec)
# ---------- end point_vector_2 ----------
curve_2 = Python3Script()  # -> out, pts, curve, rail, surface
# ---------- curve_2: Python ----------
import rhinoscriptsyntax as rs

pts = [rs.AddPoint(i, i * i * 0.1, 0) for i in range(-5, 6)]
curve = rs.AddInterpCurve(pts, degree=3)

rail_start = (0, 0, 0)
rail_end = (0, 0, 10)
rail = rs.AddLine(rail_start, rail_end)

surface = rs.ExtrudeCurveStraight(curve, (0, 0, 0), (0, 0, 5))
# ---------- end curve_2 ----------
brep_2 = Python3Script()  # -> out, sphere, brep, brep_x
# ---------- brep_2: Python ----------
import rhinoscriptsyntax as rs

center = (0, 0, 0)
radius = 5
sphere = rs.AddSphere(center, radius)
brep = sphere
brep_x = rs.CopyObject(sphere, translation=(10, 0, 0))
# ---------- end brep_2 ----------
geo_10 = Geometry(curve_2.curve)
geo_11 = Geometry(curve_2.surface)
geo_12 = Geometry(brep_2.brep)
geo_13 = Geometry(point_vector_2.moved)
geo_14 = Geometry(point_vector_2.base)
geo_15 = Geometry(curve_2.pts)
geo_16 = Geometry(curve_2.rail)
geo_17 = Geometry(brep_2.sphere)
geo_18 = Geometry(brep_2.brep_x)

# ---- group: Load Python Code
point_vector_3 = Python3Script(script=[{MarshGuids=True, MarshInputs=True, MarshOutputs=True, Text="aW1wb3J0IFJoaW5vLkdlb21ldHJ5IGFzIGdlbw0KDQpiYXNlID0gZ2VvLlBvaW50M2QoMCwgMCwgMCkNCnZlYyA9IGdlby5WZWN0b3IzZCgxMCwgNSwgMykNCm1vdmVkID0gYmFzZSArIHZlYw0K", Title="01_points_vectors.py", Uri="file:///C:/Users/bsh96/Documents/GitHub/DesignAutomationLecture/Week1_Geometry_Basics/01_points_vectors.py", Taxon="*.*.python"}, {MarshGuids=True, MarshInputs=True, MarshOutputs=True, Text="aW1wb3J0IFJoaW5vLkdlb21ldHJ5IGFzIGdlbw0KDQpiYXNlID0gZ2VvLlBvaW50M2QoMCwgMCwgMCkNCnZlYyA9IGdlby5WZWN0b3IzZCgxMCwgNSwgMykNCm1vdmVkID0gYmFzZSArIHZlYw0K", Title="01_points_vectors.py", Uri="file:///C:/Users/bsh96/Documents/GitHub/LausLecture/Lecture1/01_points_vectors.py", Taxon="*.*.python"}])  # -> out, moved, base; same code as point_vector
curve_3 = Python3Script(script=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)  # -> out, pts, curve, rail, surface; same code as curve
brep_3 = Python3Script(script=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)  # -> out, sphere, brep, brep_x; same code as brep
geo_19 = Geometry(point_vector_3.moved)
geo_20 = Geometry(point_vector_3.base)
geo_21 = Geometry(curve_3.pts)
geo_22 = Geometry(curve_3.curve)
geo_23 = Geometry(curve_3.rail)
geo_24 = Geometry(curve_3.surface)
geo_25 = Geometry(brep_3.sphere)
geo_26 = Geometry(brep_3.brep)
geo_27 = Geometry(brep_3.brep_x)
