# Grasshopper definition find_lot.gh (Grasshopper 1.0.8)

file_path = FilePath("C:\Users\bsh96\Documents\GitHub\LausLecture\Lecture2\AL_D194_11680_20250123.shp")
python_3_script = Python3Script(file_path=file_path)  # -> out, curve, multi_curves
# ---------- python_3_script: Python ----------
# r: pyshp

import Rhino.Geometry as geo
import shapefile
import os
from typing import List, Tuple, Any, Optional


sf = shapefile.Reader(file_path, encoding="utf-8")
shapes = sf.shapes()
records = sf.records()
fields = [field[0] for field in sf.fields[1:]]

print (shapes[0])
print ("-------------")
print (records[0])
print ("-------------")
print (fields)
print ("-------------")

shape = shapes[0]

points = []
for shape_point in shape.points:
    # 객체의 타입을 확인하며 코딩
    #print (type(shape_point))
    geo_point = geo.Point3d(shape_point[0], shape_point[1], 0)
    points.append(geo_point)

curve = geo.PolylineCurve(points)

## 함수로 생성
## shape 파일의 폴리곤은 parts값을 확인하여야 몇덩어리의 폴리곤인지 파악 가능하다.

multi_part_shape = shapes[3044]

# [0, 9, 17] -> 0~9 points, 9~17points, 17~endpoints 세 덩어리의 폴리곤
print(multi_part_shape.parts)
print ("-------------")
print(multi_part_shape.points)



# 각 파트별 points 추출 (2D좌표를 3D Point로 변환)
multi_curves = []
points = multi_part_shape.points
parts = multi_part_shape.parts
for i, start in enumerate(parts):
    
    if i == len(parts) - 1:
        end = len(points)
    else:
        end = parts[i + 1]
    
    part_pts = points[start:end] # 리스트 슬라이싱
    rhino_pts = [geo.Point3d(x, y, 0) for x, y in part_pts] # 리스트 컴프리헨션
    plc = geo.PolylineCurve(rhino_pts)
    multi_curves.append(plc)
# ---------- end python_3_script ----------
py3 = Python3Script(script=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)  # -> out, all_lot_crvs, road_crvs; disabled; unedited script template
panel = Panel(py3.out)  # disabled
py3_2 = Python3Script(script=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)  # -> out, all_lot_crvs, road_crvs, landlocked_crvs; disabled; unedited script template
panel_2 = Panel(py3_2.out)  # disabled
py3_3 = Python3Script(script=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)  # -> out, all_lot_crvs, road_crvs, flag_lot_crvs; disabled; unedited script template
panel_3 = Panel(py3_3.out)  # disabled
