# Grasshopper definition shp_to_3d.gh (Grasshopper 1.0.8)

geometry = Geometry(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)
python_3_script = Python3Script(script=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)  # -> out, building_breps, terrain_mesh, road_region_curves; unedited script template
geometry_2 = Geometry(python_3_script.building_breps)
python_3_script_2 = Python3Script(script=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, path_crv=geometry, obstacles=geometry_2)  # -> out, isovist_regions, iso_points; inputs path_crv: Curve, obstacles: list of Brep; disabled; unedited script template
panel = Panel(python_3_script.out)
surface = Surface(python_3_script_2.isovist_regions)
panel_2 = Panel(python_3_script_2.out)
