# Grasshopper definition parking_layout_automation.gh (Grasshopper 1.0.8)

geometry = Geometry(<curve referenced from the Rhino model>)
geometry_2 = Geometry(<point referenced from the Rhino model>)
python_3_script = Python3Script(script=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, target_region=geometry, entrance_pt=geometry_2)  # -> out, cells; inputs target_region: Curve, entrance_pt: Point3d; unedited script template
offset_curve = OffsetCurve(Curve=python_3_script.cells, Distance="-0.1", Corners=1)
panel = Panel(python_3_script.out)
